# Grasshopper definition CreateBarTemperatureLoad.gh (Grasshopper 0.9.76)
# plug-ins: Alligator

# ----
# Create Adapter Here
# File Path to reference model file
# Plug structural adapter in to this component.
path = FilePath("C:\Users\pnugent\Desktop\wgsdgh.mdl")

bhom = BHoMObject()
panel = Panel("BHoM Loadcase")
bhom_2 = BHoMObject([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])
push = Push(Adapter=bhom, Objects=bhom_2, Active=Toggle(False))  # -> Success, Objects
loadcase = Loadcase(
    Name="Loadcase1",
    Number=Slider(1, range=0..10),
    Nature="{ \"_t\" : \"System.Enum\", \"TypeName\" : { \"_t\" : \"System.Type\", \"Name\" : \"BH.oM.Structure.Loads.LoadNature\" }, \"Value\" : \"Other\" }",
    Component="{ .Loadcase")

# ----
# CreateBarTemperatureLoad
number_slider = Slider(10, range=0..10)

bartemperatureload = BarTemperatureLoad(
    Loadcase=loadcase,
    TemperatureChange=number_slider,
    Objects=push.Objects,
    Axis="{ \"_t\" : \"System.Enum\", \"TypeName\" : { \"_t\" : \"System.Type\", \"Name\" : \"BH.oM.Structure.Loads.LoadAxis\" }, \"Value\" : \"Global\" }",
    Projected=False,
    Name="Bar Temp Load",
    Component="{ .BarTemperatureLoad")
bhom_3 = BHoMObject(bartemperatureload)
push_2 = Push(Adapter=bhom, Objects=bhom_3, Active=push.Success, Component="{ .Push")  # -> Objects, Success
